# Grasshopper definition braccio Grasshopper.gh (Grasshopper 1.0.7)
# plug-ins: easySerial

# 3) send the movement to the robot
speed = Slider(10, range=0..10)
wrist_rotation = Slider(-79, range=-90..90)
wrist = Slider(-90, range=-90..90)
elbow = Slider(52, range=-90..90)
shoulder = Slider(-26, range=-90..90)
# 1) load the Braccio file in Rhino
# 2) move the robot with the sliders
gripper = Slider(71, range=40..100)
base = Slider(23, range=0..180)
# 4) choose your mode: direct send or list execution
move_robot = Button()
direct_send_list = BooleanToggle(True)

addition = Addition(A=wrist_rotation, B="90")
addition_2 = Addition(A=wrist, B="90")
addition_3 = Addition(A=elbow, B="90")
# adjustments
addition_4 = Addition(A=shoulder, B="90")

remap = RemapNumbers(Value=speed, Source="0 to 10", Target="50 to 0")  # -> Mapped, Clipped
# string to send
concat = Concatenate(
    FragmentA=base,
    FragmentB=",",
    FragmentC=addition_4,
    FragmentD=",",
    FragmentE=addition_3,
    FragmentF=",",
    FragmentG=addition_2,
    FragmentH=",",
    FragmentI=addition,
    FragmentJ=",",
    FragmentK=gripper,
    FragmentL=",",
    FragmentM=remap.Mapped)

remove_movement = Button()
add_movement = Button()
reset_position = Button()
clear_list = Button()
python = GhPythonScript(
    servo_string=concat,
    add_button=add_movement,
    remove_button=remove_movement,
    clear_button=clear_list,
    reset_button=reset_position,
    trigger=move_robot)  # -> out, full_list, now_sending
# ---------- python: Python ----------
import rhinoscriptsyntax as rs
import Grasshopper.Kernel as gh

# Global variables
global servo_list, current_position, current_index

if 'servo_list' not in globals():
    servo_list = []
if 'current_position' not in globals():
    current_position = "90,90,90,90,90,90"
if 'current_index' not in globals():
    current_index = 0

def add_to_list(servo_string):
    global servo_list
    if servo_string not in servo_list:
        servo_list.append(servo_string)

def remove_from_list(servo_string):
    global servo_list
    if servo_string in servo_list:
        servo_list.remove(servo_string)

def clear_list():
    global servo_list, current_index
    servo_list = []
    current_index = 0

def reset_position():
    global servo_list, current_position, current_index
    servo_list = ["90,90,90,90,90,90"]
    current_position = "90,90,90,90,90,90"
    current_index = 0

def rotate_list():
    global servo_list, current_position, current_index
    if servo_list:
        current_index = (current_index + 1) % len(servo_list)
        current_position = servo_list[current_index]

# Handle button clicks
if add_button:
    add_to_list(servo_string)
elif remove_button:
    remove_from_list(servo_string)
elif clear_button:
    clear_list()
elif reset_button:
    reset_position()

# Rotate the list when triggered
if trigger:
    rotate_list()

# Output
full_list = servo_list
now_sending = current_position
# ---------- end python ----------
panel = Panel(python.now_sending)
panel_2 = Panel(python.full_list)

panel_3 = Panel(concat)
filter = StreamFilter(Gate=direct_send_list, Stream0=panel, Stream1=panel_3)

# ----
# 5) serial communication setup
toggle = BooleanToggle(True)
easyserial = EasySerial(ONOFF=toggle, Baud=9600, Port="COM9", DataOut=filter, Mode=Slider(3, range=0..10), Trigger=move_robot)  # -> Status, Sent, Received
panel_4 = Panel(easyserial.Status)

panel_5 = Panel(easyserial.Received)
panel_6 = Panel(filter)
split = TextSplit(Text=filter, Separators=",")
item = ListItem(List=split, Index=1, Wrap=True)
item_2 = ListItem(List=split, Index=5, Wrap=True)
item_3 = ListItem(List=split, Index=4, Wrap=True)
item_4 = ListItem(List=split, Index=3, Wrap=True)
item_5 = ListItem(List=split, Index=2, Wrap=True)
item_6 = ListItem(List=split, Index=0, Wrap=True)
# shoulder
subtraction = Subtraction(A=item_5, B="90")
subtraction_2 = Subtraction(A=item_3, B="90")
# elbow
subtraction_3 = Subtraction(A=item_4, B="90")
# adjustments (base and gripper)
panel_7 = Panel("30 to -3")
remap_2 = RemapNumbers(Value=item_2, Source="40 to 100", Target=panel_7)  # -> Mapped, Clipped
remap_3 = RemapNumbers(Value=item_6, Source="0 to 180", Target="180 to 0")  # -> Mapped, Clipped

# ----
# wrist rotation
gripper_pivot = Point(Point(0, 310, 71.5))
xz = XZPlane(Origin=gripper_pivot)

# ----
# gripper
finger_pivots = Point([Point(-26.81646155, 341.0065351, 0), Point(-8.380146057, 341.0065367, 0)])
mirror_point = Point(Point(0.8799167937, 347.7106497, 0))
rad = Radians(Degrees=remap_2.Mapped)
# Visual update of the model
yz = YZPlane(Origin=mirror_point)
xy = XYPlane(Origin=finger_pivots)
fingers = Mesh([<mesh referenced from the Rhino model> x3])
rotate = Rotate(Geometry=fingers, Angle=rad, Plane=xy)  # -> Geometry, Transform
mirror = Mirror(Geometry=rotate.Geometry, Plane=yz)  # -> Geometry, Transform

shoulder_pivot = Point(Point(0, 0, 71.5))
yz_2 = YZPlane(Origin=shoulder_pivot)
rad_2 = Radians(Degrees=item)
shoulder_2 = Mesh(<mesh referenced from the Rhino model>)

wrist_rotation_2 = Mesh(<mesh referenced from the Rhino model>)
rad_3 = Radians(Degrees=subtraction_2)

wrist_wrist_rot = Merge(Data1=mirror.Geometry, Data2=rotate.Geometry, Data3=wrist_rotation_2)

rotate_2 = Rotate(Geometry=wrist_wrist_rot, Angle=rad_3, Plane=xz)  # -> Geometry, Transform

rad_4 = Radians(Degrees=subtraction_3)
elbow_2 = Mesh([<mesh referenced from the Rhino model> x2])

elbow_pivot = Point(Point(0, 125, 71.5))
wrist_pivot = Point(Point(0, 250, 71.5))
wrist_wrist_rot_2 = Merge(Data1=rotate_2.Geometry, Data2=elbow_2)

yz_3 = YZPlane(Origin=wrist_pivot)
# wrist
rotate_3 = Rotate(Geometry=wrist_wrist_rot_2, Angle=rad_4, Plane=yz_3)  # -> Geometry, Transform

yz_4 = YZPlane(Origin=elbow_pivot)
rad_5 = Radians(Degrees=subtraction)
elbow_3 = Mesh(<mesh referenced from the Rhino model>)

rad_6 = Radians(Degrees=remap_3.Mapped)
base_pivot = Point(Point(0, 0, 0))
xy_2 = XYPlane(Origin=base_pivot)
base_2 = Mesh([<mesh referenced from the Rhino model> x4])

wrist_elbow = Merge(Data1=rotate_3.Geometry, Data2=elbow_3)

rotate_4 = Rotate(Geometry=wrist_elbow, Angle=rad_5, Plane=yz_4)  # -> Geometry, Transform

elbow_shoulder = Merge(Data1=rotate_4.Geometry, Data2=shoulder_2)

rotate_5 = Rotate(Geometry=elbow_shoulder, Angle=rad_2, Plane=yz_2)  # -> Geometry, Transform

shoulder_base = Merge(Data1=rotate_5.Geometry, Data2=base_2)

# ----
# base
rotate_6 = Rotate(Geometry=shoulder_base, Angle=rad_6, Plane=xy_2)  # -> Geometry, Transform
